# Grasshopper definition InsideOutside.gh (Grasshopper 1.0.7)
# plug-ins: ShowMeGrasshopper

rec = Rectangle({Plane=PlaneXY(-15.00579004, -0.6602547617, 0), Size=Domain2(u=-10.26396039..10.26396039, v=-5.522130734..5.522130734)})
pt = Point(Point(-13.26511839, -0.6602547617, 0))
smg_i = ShowMeGrasshopper_Intersects(Rectangle=rec, Point=pt)
rgb = ColourRGB(Alpha=255, Red=0, Green=0, Blue=0)
pt_2 = Point(Point(-0.780301082, -11.70451623, 0))
tag = TextTag(Location=pt_2, Text=smg_i, Colour=rgb)
